# Grasshopper definition gh_brep_to_json.gh (Grasshopper 1.0.7)

go = BooleanToggle(True)
geo = Geometry([<brep referenced from the Rhino model> x2])
purple = Geometry([<brep referenced from the Rhino model> x10])
brep = Brep(geo)
python = GhPythonScript(knots=purple, run=Toggle(True))  # -> out; inputs knots: list of Brep
# ---------- python: Python ----------
# THIS FILE SHOULD EXIST IN GRASSHOPPER GHPYTHON
__author__ = "ceep"
__version__ = "2023.03.01"

import Rhino.Geometry as rg

import json
import os
import time

def main():

    date =  time.strftime("%y%m%d")
    save_dir = os.path.abspath("./data/"+ date)
    if not os.path.exists(save_dir):
        os.makedirs(save_dir)

    j_Brep = {}
    for b_id, _B in enumerate(knots):

        j_Brep[b_id] = {}

        v = _B.Vertices
        e = _B.Edges
        f = _B.Faces

        l = [list(set(x.EdgeIndices())) for x in v]
        if any(len(x)==1 for x in l):
            res, pl = e[l[1][1]].TryGetPlane()
            if res:
                o = pl.Origin
                r1 = rg.Line(o, v[1].Location).Length
                r2 = 1
                h = rg.Line(o, v[0].Location).Length
                j_Brep[b_id]["vtx"] = [o.X, o.Y, o.Z]
                j_Brep[b_id]["rad"] = [r1, r2]
                j_Brep[b_id]["vec"] = [pl.ZAxis.X*h, pl.ZAxis.Y*h, pl.ZAxis.Z*h]


    saved = os.path.join(save_dir,"knots.json")
    with open(saved, "w") as f:
        json.dump(j_Brep, f,indent=4)
    print (saved)
    return saved

if run:
    saved = main()
# ---------- end python ----------
go_2 = Panel(go)
python_2 = GhPythonScript(solid=brep, run=go)  # -> out, saved; inputs solid: list of Brep, run: Boolean
# ---------- python_2: Python ----------
# THIS FILE SHOULD EXIST IN GRASSHOPPER GHPYTHON
__author__ = "ceep"
__version__ = "2023.02.02"


import json
import os
import time

def main():

    date =  time.strftime("%y%m%d")
    save_dir = os.path.abspath("./data/"+ date)
    if not os.path.exists(save_dir):
        os.makedirs(save_dir)

    j_Brep = {}
    for b_id, _B in enumerate(solid):

        j_Brep[b_id] = {"vtx":{}, "edg":{}, "lop":{}, "fac":{}}

        _v_ls = [v for v in _B.Vertices]
        e_ls = _B.Edges
        l_ls = _B.Loops
        f_ls = _B.Faces

        for _v in _v_ls:
            j_Brep[b_id]["vtx"][_v.ComponentIndex().Index] = {"pos":[_v.Location.X, _v.Location.Y, _v.Location.Z]}
        
        for e in e_ls:
            stp_id = e.StartVertex.ComponentIndex().Index
            end_id = e.EndVertex.ComponentIndex().Index
            sgm = e.DuplicateSegments()
            D = sgm[0].Degree

            j_Brep[b_id]["edg"][e.ComponentIndex().Index] = {"vtx":[stp_id, end_id], "degree":D}

            if D > 1:
                e_cp = []
                e_w = []
                for cp in sgm[0].Points:
                    e_cp.append([cp.Location.X, cp.Location.Y, cp.Location.Z])
                    e_w.append(cp.Weight)
                j_Brep[b_id]["edg"][e.ComponentIndex().Index].update({"cp":e_cp, "w":e_w})

        for l in l_ls:
            j_Brep[b_id]["lop"][l.ComponentIndex().Index] = {"edg":[a.Edge.ComponentIndex().Index for a in l.Trims]}

        for f in f_ls:

            nf = f.ToNurbsSurface()
            dU = nf.Degree(0)
            dV = nf.Degree(1)
            f_w = [cp.Weight for cp in nf.Points]

            j_Brep[b_id]["fac"][f.ComponentIndex().Index] = {"lop":[a.ComponentIndex().Index for a in f.Loops], "edg": [a for a in f.AdjacentEdges()], "degree":[dU, dV] , "w":f_w}
    saved = os.path.join(save_dir,"model.json")
    with open(saved, "w") as f:
        json.dump(j_Brep, f,indent=4)
    return saved

if run:
    saved = main()
# ---------- end python_2 ----------
panel = Panel(python_2.saved)
panel_2 = Panel(python)
